# Dynamo graph Create Filled Region by Floor and Trim Benches and Bins_v11(work in progress).dyn (Dynamo 2.3.0.5885)

select_model_elements_floors = DSModelElementsSelection()  # 1 picked in the model
code_block = CodeBlock(floor_Or_FloorList=select_model_elements_floors) { floor_Or_FloorList; }
filled_region_type_name = StringInput("Vertical")  # graph input
python_script = Python(IN[0]=code_block, IN[1]=filled_region_type_name)
# ---------- python_script.python (225 lines) ----------
import clr
import sys
import System
clr.AddReference('ProtoGeometry')
from Autodesk.DesignScript.Geometry import *
import Autodesk.DesignScript.Geometry as DS

clr.AddReference("RevitServices")
import RevitServices
from RevitServices.Persistence import DocumentManager
from RevitServices.Transactions import TransactionManager
doc = DocumentManager.Instance.CurrentDBDocument

clr.AddReference("RevitNodes")
import Revit
clr.ImportExtensions(Revit.Elements)
clr.ImportExtensions(Revit.GeometryConversion)

clr.AddReference("RevitAPI")
from Autodesk.Revit.DB import *

from System.Collections.Generic import List

pf_path = System.Environment.GetFolderPath(System.Environment.SpecialFolder.ProgramFilesX86)
sys.path.append('%s\IronPython 2.7\Lib' % pf_path)
from cStringIO import StringIO
sys.stdout = StringIO()


def tolist(obj1):
	if hasattr(obj1,"__iter__"): return obj1
	else: return [obj1]

def getTopFace(elem):
	opt = Options()
	lstFGeo = elem.get_Geometry(opt)
	for geo in lstFGeo:
		if isinstance(geo, Solid):
			for face in geo.Faces:
				if isinstance(face, PlanarFace) and face.FaceNormal.IsAlmostEqualTo(XYZ.BasisZ):
					edgLoopArr =  face.EdgeLoops 
					ZFloor = face.Origin.Z
					return edgLoopArr, face, ZFloor
					
def getSketchAndFaces(floor):
	#get lst of Top Faces
	lstFace = []
	opt = Options()
	lstFGeo = floor.get_Geometry(opt)
	for geo in lstFGeo:
		if isinstance(geo, Solid):
			for face in geo.Faces:
				bbxUv = face.GetBoundingBox()
				centerUv = (bbxUv.Max + bbxUv.Min) / 2
				normal = face.ComputeNormal(centerUv)
				normal = normal.Normalize()
				if normal.DotProduct(XYZ.BasisZ) > 0.5 :
					#ZFloor = face.Origin.Z
					lstFace.append(face)
					
	#find the sketchlines with the TTT  (temporary transaction trick)				
	if len(lstFace) > 0:	
		TransactionManager.Instance.ForceCloseTransaction()	
		t1 = Transaction(doc, "temp")
		t1.Start()
		deleted = doc.Delete(floor.Id)
		t1.RollBack()
		for d in deleted:
			test_el = doc.GetElement(d)
			if isinstance(test_el, Sketch):
				profileArry = test_el.Profile
				skplane = test_el.SketchPlane 
				plane = skplane.GetPlane()
				ZFloor = plane.Origin.Z
				t1.Dispose()
				return profileArry, lstFace, ZFloor
		t1.Dispose()			
	return None, None, None		
	
				
def getCurvloopBBx(elem, ZFloor):
	#subfunction
	def flattenGen(*args):
		for x in args:
			if hasattr(x, "__iter__") and not isinstance(x, str):
				for y in flattenGen(*x) : yield y
			else: yield x
	        
	def createCurveLoop(lstPoint):
		curves = []
		for idx, pt in enumerate(lstPoint):
			if idx > 0:
				line = Line.CreateBound(lstPoint[idx -1], pt)
				curves.append(line)
			else:	
				line = Line.CreateBound(lstPoint[-1], lstPoint[0])
				curves.append(line)		
		curveLoop = CurveLoop.Create(curves)	
		return curveLoop		

	def SumBoxes(boxes):
		minx = min([b.Min.X for b in boxes])
		miny = min([b.Min.Y for b in boxes])
		minz = min([b.Min.Z for b in boxes])
		maxx = max([b.Max.X for b in boxes])
		maxy = max([b.Max.Y for b in boxes])
		maxz = max([b.Max.Z for b in boxes])
		bb = BoundingBoxXYZ()
		bb.Min = XYZ(minx,miny,minz)
		bb.Max = XYZ(maxx,maxy,maxz)
		return bb


	def GeoBox(g):
		box = g.GetBoundingBox()
		origin = box.Transform.Origin
		box.Min = box.Min.Add(origin)
		box.Max = box.Max.Add(origin)
		return box
	#main function
	#get angle from familyInstance
	transform = elem.GetTransform()
	vectorTran = transform.OfVector(transform.BasisX)
	angle = transform.BasisX.AngleOnPlaneTo(vectorTran, transform.BasisZ)
	#nalyse geometry
	boxes = []
	opt = Options()
	solids,boxes = [],[]
	instGeo = elem.get_Geometry(opt)
	for ig in instGeo:
		if ig.GetType() == Solid:
			gstyle = g.Visibility 
			print(gstyle)
			box = GeoBox(ig)
			boxes.append(box)
			solids.append(ig)
		else:			
			for g in flattenGen(ig.GetInstanceGeometry()):
				if g.GetType() == Solid:
					gstyle = g.Visibility 
					print(gstyle)
					box = g.GetBoundingBox()
					if box.Max.X < 99999:					
						box = GeoBox(g)
						boxes.append(box)
						solids.append(g)
	instGeo.Dispose()				
	sumBox = SumBoxes(boxes)
	center = box.Max.Add(box.Min).Multiply(0.5)
	#transform geometry at angle (reverse)
	rotatedBoxes = []
	for solid in solids:
		t = Transform.CreateRotationAtPoint(XYZ.BasisZ,-angle,center)
		g = SolidUtils.CreateTransformed(solid,t)
		rotatedBoxes.append(GeoBox(g))
		solid.Dispose()			
	#get Bounding Box of  geometries transformed
	sumBox = SumBoxes(rotatedBoxes)
	minp = sumBox.Min
	maxp = sumBox.Max
	
	p1 = XYZ(minp.X,minp.Y,ZFloor)
	p3 = XYZ(maxp.X,maxp.Y,ZFloor)
	p2 = XYZ(minp.X,maxp.Y,ZFloor)
	p4 = XYZ(maxp.X,minp.Y,ZFloor)
	
	t2 = Transform.CreateRotationAtPoint(XYZ.BasisZ,angle,center)
	listPts = [t2.OfPoint(p) for p in [p1,p2,p3,p4]]
	curvloop = createCurveLoop(listPts)
	return curvloop
	
			
toList = lambda x : x if hasattr(x, '__iter__') else [x]
lstfloor = toList(UnwrapElement(IN[0]))
filledRegionName = IN[1]
view = doc.ActiveView
#ZFloor = 0

filledType =  FilteredElementCollector(doc).OfClass(FilledRegionType).ToElements().Find(lambda x : Element.Name.GetValue(x) == filledRegionName)

out = []
lsterror = []
outcurvDS = []
for floor in lstfloor:
	if isinstance(floor, Floor):
		edgLoopArr, lstFace, ZFloor = getSketchAndFaces(floor)
		
		#convert Array Edges Loop in listCurveloop
		boundariesLoop = List[CurveLoop]()
		for lstEdg in edgLoopArr:
			lstCurvDS = [x.ToProtoType() for x in lstEdg]
			polycurvDS = DS.PolyCurve.ByJoinedCurves(lstCurvDS)
			lstCurv = List[Curve]([x.ToRevitType() for x in polycurvDS.Curves()])
			#curvLoop = CurveLoop.Create(lstCurv)
			curvLoop = CurveLoop.Create(lstCurv)
			boundariesLoop.Add(curvLoop)


		#Create Multi category filter
		cat_list = [BuiltInCategory.OST_Furniture, BuiltInCategory.OST_GenericModel]
		typed_list = List[BuiltInCategory](cat_list)
		filtercat = ElementMulticategoryFilter(typed_list)
		fecmultiplefilter = FilteredElementCollector(doc).WherePasses(filtercat).WhereElementIsNotElementType().ToElements()
		for elemMob in fecmultiplefilter:
			for floorface in lstFace:
				interResult = floorface.Project(elemMob.Location.Point)
				if interResult is not None and interResult.Distance < 0.1:
					#contruct a new loop curve and add at the prinicipal loop
					curvLoop = getCurvloopBBx(elemMob, ZFloor)
					outcurvDS.append([x.ToProtoType() for x in curvLoop])
					boundariesLoop.Add(curvLoop)
		try:
			TransactionManager.Instance.EnsureInTransaction(doc)
			filled = FilledRegion.Create(doc, filledType.Id, view.Id, boundariesLoop)
			TransactionManager.Instance.TransactionTaskDone()
			out.append(filled)
		except:
			import traceback
			errorReport = traceback.format_exc()  
			lsterror.append(errorReport)
		outcurvDS.append([x.ToProtoType() for curvLoop in boundariesLoop for x in curvLoop])


sys.stdout.seek(0)
OUT = out, outcurvDS, ZFloor, lsterror, sys.stdout.read()
# ----------------------------------------
select_model_element_floor = DSModelElementSelection()  # 1 picked in the model
