# Dynamo graph test Speech.Recognition_V4.dyn "test Speech.Recognition_V3" (Dynamo 2.0.4.12684)

select_model_element = DSModelElementSelection()  # 1 picked in the model
boolean = BoolSelector(false)
python_script = Python(IN[0]=select_model_element, IN[1]=boolean)
# ---------- python_script.python (96 lines) ----------
# -*- coding: utf-8 -*-
import sys
import clr
import System 
import re
clr.AddReference('ProtoGeometry')
from Autodesk.DesignScript.Geometry import *

#import Revit API
clr.AddReference('RevitAPI')
import Autodesk
from Autodesk.Revit.DB import *

clr.AddReference('RevitAPIUI')
from Autodesk.Revit.UI import *


clr.AddReference('RevitServices')
import RevitServices
from RevitServices.Persistence import DocumentManager
from RevitServices.Transactions import TransactionManager

doc = DocumentManager.Instance.CurrentDBDocument
uiapp = DocumentManager.Instance.CurrentUIApplication

clr.AddReference("System.Windows.Forms")
import System.Windows.Forms
from System.Windows.Forms import * 

clr.AddReference("System.Speech, Version=3.0.0.0, Culture=neutral, PublicKeyToken=31bf3856ad364e35")
from System.Speech.Recognition import (SpeechRecognitionEngine, GrammarBuilder, Grammar, Choices, RecognizeMode)
from System.Threading import Thread, ThreadStart, ApartmentState

count = 0

def up():
	global elem
	TransactionManager.Instance.EnsureInTransaction(doc)
	MoveElements(doc, elem.Id, XYZ(0,0,0.5))
	TransactionManager.Instance.TransactionTaskDone()
	doc.Regenerate()

def mirror():
	uiapp.PostCommand(RevitCommandId.LookupPostableCommandId(PostableCommand.MirrorProject))

class ModExtEventMirror(IExternalEventHandler):
	def __init__(self, ToDo):
		self.ToDo = ToDo
	
	def Execute(self, _uiap):
		self.ToDo() 
		
	def GetName(self):
		return "EventMiroring"		

def main():
	global ext_event
	sre = SpeechRecognitionEngine()
	sre.SetInputToDefaultAudioDevice()
	sre.UnloadAllGrammars()

	gb = GrammarBuilder()
	gb.Append(Choices('up', 'quit'))
	sre.LoadGrammar(Grammar(gb))
	
	
	def OnSpeechRecognized(sender, e):
		#MessageBox.Show(e.Result.Text)
		if e.Result.Text == 'quit':
			MessageBox.Show("SpeechRecognition Stop")
			thread.Join()
			thread.Abort()
		elif re.match(r'[Uu]p', e.Result.Text) is not None:    
			MessageBox.Show(e.Result.Text)
			ext_event.Raise()
			#thread.Join()
			#thread.Abort()
			
	

	sre.SpeechRecognized += OnSpeechRecognized

	sre.RecognizeAsync(RecognizeMode.Multiple)

	raw_input('')

elem  = UnwrapElement(IN[0])
if sys.platform == 'cli':
	obj_handler = ModExtEventMirror(up)
	ext_event = ExternalEvent.Create(obj_handler)
	MessageBox.Show("Say up OR quit")
	thread = Thread(ThreadStart(main))
	thread.Start()

		
OUT = sys.platform        
# ----------------------------------------
python_script_2 = Python()  # frozen; unwired: IN[0]
# ---------- python_script_2.python (261 lines) ----------
import clr
import sys
import time
import re
clr.AddReference('ProtoGeometry')
from Autodesk.DesignScript.Geometry import *

#import Revit API
clr.AddReference('RevitAPI')
import Autodesk
from Autodesk.Revit.DB import *
#import specify namespace
from Autodesk.Revit.DB.Electrical import *

#import Revit APIUI namespace
clr.AddReference('RevitAPIUI')
from Autodesk.Revit.UI import *

#import net library
clr.AddReference('System')
from System.Collections.Generic import List

clr.AddReference('RevitNodes')
import Revit
clr.ImportExtensions(Revit.GeometryConversion)
clr.ImportExtensions(Revit.Elements)

#import transactionManager and DocumentManager (RevitServices is specific to Dynamo)
clr.AddReference('RevitServices')
import RevitServices
from RevitServices.Persistence import DocumentManager
from RevitServices.Transactions import TransactionManager

#Get Important vars
#Get Important vars
doc = DocumentManager.Instance.CurrentDBDocument
uiapp = DocumentManager.Instance.CurrentUIApplication
uidoc = uiapp.ActiveUIDocument
app = uiapp.Application
sdkNumber = int(app.VersionNumber)


clr.AddReference('System.Drawing')
clr.AddReference('System.Windows.Forms')
import System.Drawing
import System.Windows.Forms

from System.Drawing import *
from System.Windows.Forms import *


import System
from System.Threading import *
from System.Collections.Generic import Dictionary

myDoc_path = System.Environment.GetFolderPath(System.Environment.SpecialFolder.MyDocuments)
pf_path = System.Environment.GetFolderPath(System.Environment.SpecialFolder.ProgramFilesX86)
sys.path.append('%s\IronPython 2.7\Lib' % pf_path)
import json
from cStringIO import StringIO
sys.stdout = StringIO()



class FormMirror(Form):
	def __init__(self, nameProject):
		self._nameProject = "Data File found, Project : {}".format( nameProject) if nameProject is not None else "Not Datas"
		self._enableFix = True  if nameProject is not None else False 
		self.UIChoice = None
		self.InitializeComponent()
	
	def InitializeComponent(self):
		self._buttonMirror = System.Windows.Forms.Button()
		self._buttonFix = System.Windows.Forms.Button()
		self._labelProject = System.Windows.Forms.Label()
		self.SuspendLayout()
		# 
		# buttonMirror
		# 
		self._buttonMirror.Location = System.Drawing.Point(36, 47)
		self._buttonMirror.Name = "MirrorP"
		self._buttonMirror.Size = System.Drawing.Size(148, 61)
		self._buttonMirror.TabIndex = 0
		self._buttonMirror.Text = "1/Mirror Project"
		self._buttonMirror.UseVisualStyleBackColor = True
		self._buttonMirror.Click += self.ButtonClick
		# 
		# buttonFix
		# 
		self._buttonFix.Location = System.Drawing.Point(239, 47)
		self._buttonFix.Name = "FixWires"
		self._buttonFix.Size = System.Drawing.Size(148, 61)
		self._buttonFix.TabIndex = 0
		self._buttonFix.Text = "2/Fix Wires"
		self._buttonFix.UseVisualStyleBackColor = True
		self._buttonFix.Enabled = self._enableFix
		self._buttonFix.Click += self.ButtonClick
		# 
		# labelProject
		# 
		self._labelProject.Location = System.Drawing.Point(50, 13)
		self._labelProject.Name = "labelProject"
		self._labelProject.Size = System.Drawing.Size(300, 23)
		self._labelProject.TabIndex = 1
		self._labelProject.Text = self._nameProject 
		# 
		# FormMirror
		# 
		self.ClientSize = System.Drawing.Size(430, 131)
		self.Controls.Add(self._labelProject)
		self.Controls.Add(self._buttonFix)
		self.Controls.Add(self._buttonMirror)
		self.Name = "FormMirror"
		self.Text = "FormMirror"
		self.ResumeLayout(False)


	def ButtonClick(self, sender, e):
		self.UIChoice = sender.Name
		self.Close()

class WireUtils():
	#
	instances  = []
	#
	def __init__(self, elemWire):
		self.wireId = elemWire.Id.IntegerValue
		self.onwerViewId = elemWire.OwnerViewId.IntegerValue
		self.numberVertices = elemWire.NumberOfVertices 
		self.dictOldVertices = {}
		for x in range(self.numberVertices):
			self.dictOldVertices[x] = elemWire.GetVertex(x).ToString()
			
		#WireUtils.instances.add(self)	
		# OR		
		self.__class__.instances.append(self)	
			
	@classmethod
	def get_instances(cls):
		return cls.instances	
		
	@classmethod
	def get_ElemInstances(cls):
		return [x.wireId for x in cls.instances ]			


def app_thread():
	uiapp.PostCommand(RevitCommandId.LookupPostableCommandId(PostableCommand.MirrorProject))
	

def getDatafromJsonDict(jsonLoad, valueStr):
	out = []
	for dictx in jsonLoad:
		value = dictx.get(valueStr)
		if value is not None:
			if re.match(r'[\[\{]', value) is not None:
				out.append(eval(value))
			else:	
				out.append(value)
	if len(out) == 1:
		return out[0]
	else:
		return out	
		
def findFamilyInstance(elem):
	ptBase = XYZ.Zero
	if isinstance(elem.Location, LocationPoint):
		if ptBase.DistanceTo(elem.Location.Point) > 10: 
			return True				

lstInstJson = []
filePath = myDoc_path + "\\dataWire.json"
testFile = System.IO.File.Exists(filePath)
titleProj = None
jsonLoad = None
if testFile:
	with open(filePath) as json_file:
		jsonLoad = json.load(json_file)
		titleProj = getDatafromJsonDict(jsonLoad, "Project")
		#jsonLoad =  json.loads(jsonStr2)
		

objForm  = FormMirror(titleProj)
objForm.ShowDialog()
		
if objForm.UIChoice == "MirrorP":
	TaskDialog.Show("Info", "After Mirror Project relaunch Script to Fix Wires")
	lstInstJson.append(dict(Project = doc.Title))
	
	oneElem = FilteredElementCollector(doc).OfClass(FamilyInstance).WhereElementIsNotElementType().ToElements().Find(lambda x : findFamilyInstance(x))
	oldLoc = oneElem.Location.Point
	dictDiffLoc = {oneElem.Id.IntegerValue : oldLoc.ToString()}
	jsonStrLoc = json.dumps(dictDiffLoc)
	#load json into a new dict
	lstInstJson.append(dict(LocData=jsonStrLoc))
	
	wireInViewFunc = lambda x : not x.IsTemplate and FilteredElementCollector(doc, x.Id).OfClass(Wire).ToElements().Count > 0 
	fecViews = FilteredElementCollector(doc).OfClass(Autodesk.Revit.DB.View).WhereElementIsNotElementType().ToElements().FindAll(wireInViewFunc)
	for view in fecViews:
		fecWire = FilteredElementCollector(doc, view.Id).OfClass(Wire).WhereElementIsNotElementType()	
		for wire in fecWire:
			objWire = WireUtils(wire)
			#convert to JSON string
			jsonStr = json.dumps(objWire.__dict__)
			lstInstJson.append(dict(wireData=jsonStr))
	
	lstObjWire = WireUtils.get_instances()
	#other Way
	#jsonStr2 = json.dumps([dict(wireData=pn) for pn in lstInstJson])
	jsonStr2 = json.dumps(lstInstJson)
	
	with open(filePath, 'w') as f:
		f.write(jsonStr2)
	
	#mirror Project in a new Thread
	thread = Thread(ThreadStart(app_thread))
	thread.SetApartmentState(ApartmentState.STA)
	thread.Start()
	thread.Join()

elif jsonLoad is not None:
	if getDatafromJsonDict(jsonLoad, "Project") == doc.Title:
		#Do some action in a Transaction
		TransactionManager.Instance.EnsureInTransaction(doc)
		#get the axis
		dictOldLoc = getDatafromJsonDict(jsonLoad, "LocData")
		dictLocKey = next(iter(dictOldLoc))
		dictLocValue = dictOldLoc.get(dictLocKey)
		oldLoc = eval("XYZ" + dictLocValue)
		elemLoc = doc.GetElement(ElementId(int(dictLocKey)))
		if oldLoc.DistanceTo(elemLoc.Location.Point) > 0.01:
			lineAB = Autodesk.Revit.DB.Line.CreateBound(oldLoc, elemLoc.Location.Point)
			midPt = lineAB.Evaluate(0.5, True)
			vectToLine = Autodesk.Revit.DB.Line.CreateBound(midPt, lineAB.GetEndPoint(1))
			vectLine = vectToLine.Direction 
			#calculate the transform
			plane = Plane.CreateByNormalAndOrigin(vectLine, midPt)
			planeProto = Autodesk.DesignScript.Geometry.Plane.ByOriginNormal(plane.Origin.ToPoint(), plane.Normal.ToVector())
			transf = Transform.CreateReflection(plane)
			#get Data from old wires
			lstWires = getDatafromJsonDict(jsonLoad, "wireData")
			for wiredict in lstWires:
				wireId = wiredict.get("wireId")
				dictOldVertices = wiredict.get("dictOldVertices")
				elemWire = doc.GetElement(ElementId(int(wireId)))
				for i in range(elemWire.NumberOfVertices):
					oldPointStr = dictOldVertices.get(str(i))
					oldPoint = eval('XYZ' + oldPointStr)
					newPoint = transf.OfPoint(oldPoint)
					elemWire.SetVertex(i, newPoint)				
		
		TransactionManager.Instance.TransactionTaskDone()
	else:
		TaskDialog.Show("Error", "Mirror Project from Script before")	
	System.IO.File.Delete(filePath)



sys.stdout.seek(0)

OUT = titleProj, sys.stdout.read()
# ----------------------------------------

# group: Test2 if False
python_script_3 = Python()  # frozen; unwired: IN[0]
# ---------- python_script_3.python (33 lines) ----------
import clr
clr.AddReference('ProtoGeometry')
from Autodesk.DesignScript.Geometry import *

clr.AddReference('RevitAPI')
import Autodesk
from Autodesk.Revit.DB import *

clr.AddReference('RevitAPIUI')
from Autodesk.Revit.UI import *

class MyClass():
	class ModExternalEvent(IExternalEventHandler):
		def __init__(self, ToDo):
			self.ToDo = ToDo
			self.outValue = "HelloWorldTest2"
		
		def Execute(self, _uiap):
			self.ToDo() 
			
		
		def GetName(self):
			return "Test External Event"
	

		
switchTest = IN[0]
if switchTest == False:		
	OUT = MyClass
else:
	OUT = None

	
# ----------------------------------------
python_script_4 = Python(IN[0]=python_script_3)
# ---------- python_script_4.python (23 lines) ----------
import clr
clr.AddReference('ProtoGeometry')
from Autodesk.DesignScript.Geometry import *

clr.AddReference('RevitAPI')
import Autodesk
from Autodesk.Revit.DB import *

clr.AddReference('RevitAPIUI')
from Autodesk.Revit.UI import *


def helloWorld():
	TaskDialog.Show("Hello","HelloWorldTest2")
	
ModuleMyClass = IN[0]

if ModuleMyClass is not None:

	obj_handler = ModuleMyClass.ModExternalEvent(helloWorld)
	ext_event = ExternalEvent.Create(obj_handler)
	ext_event.Raise()
	OUT = obj_handler.outValue
# ----------------------------------------
watch = Watch(python_script_4)

byStartPointEndPoint = Line.ByStartPointEndPoint()  # unwired: startPoint, endPoint
byCoordinates = Point.ByCoordinates()
